# Dynamo graph Intervenability_02-LFO.dyn (Dynamo 2.19.3.6394)

python_script_originale_ms = Python()  # CPython3; frozen; unwired: IN[0], IN[1], IN[2], IN[3], IN[4], IN[5]
# ---------- python_script_originale_ms.python (314 lines) ----------
import sys, os, io

# --- Dynamo / Revit plumbing ---
import clr
clr.AddReference('RevitServices')
from RevitServices.Persistence import DocumentManager
from RevitServices.Transactions import TransactionManager

clr.AddReference('RevitAPI')
from Autodesk.Revit.DB import (
    FilteredElementCollector, BuiltInCategory, ElementCategoryFilter, LogicalOrFilter,
    Element, Color, OverrideGraphicSettings, FillPatternElement, FillPatternTarget, View
)
doc = DocumentManager.Instance.CurrentDBDocument
uidoc = DocumentManager.Instance.CurrentUIApplication.ActiveUIDocument

# --- Inputs ---
s_parameter = IN[0]
start0_file_pathandname = IN[1]
apply_in_active_view = bool(IN[2])
diameter = IN[3]
duct_size_1 = IN[4]
duct_size_2 = IN[5]
OUT = {}
OUT['s_parameter'] = s_parameter
# --- Helpers ---
def get_elements_of_categories(document):
    s_category = [
        BuiltInCategory.OST_Walls,
        BuiltInCategory.OST_Floors,
        BuiltInCategory.OST_Ceilings,
        BuiltInCategory.OST_Windows,
        BuiltInCategory.OST_Doors
    ]
    s_filter = [ElementCategoryFilter(category) for category in s_category]
    or_filter = LogicalOrFilter(s_filter)
    column = FilteredElementCollector(document).WherePasses(or_filter).WhereElementIsNotElementType()
    # stable order: sort by UniqueId
    s_element = sorted(list(column), key=lambda e: e.UniqueId)
    return s_element

def read_params(e, s_parameter):
    s_converter = {'AtticFloor_CanBeCovered': {'No': 'FALSE', 'Sì': 'TRUE'},
                    'Leaning': {'No': 'FALSE', 'Sì': 'TRUE'},
                    'Bonding': {'No': 'FALSE', 'Sì': 'TRUE'},
                    'Infill': {'No': 'FALSE', 'Sì': 'TRUE'},
                    'Demolition': {'No': 'FALSE', 'Sì': 'TRUE'},
                    'Type': {'Pavimenti': 'Surface:Floor:InnerSide',
                            'Muri': 'Surface:Wall:InnerSide',
                            'Controsoffitti': 'Surface:Ceiling:InnerSide',
                            'Tetti': 'Surface:Roof:InnerSide',
                            'Porte': 'Door/Window',
                            'Finestre': 'Door/Window'}}
    id = e.UniqueId
    OUT[id] = {}
    s_value = []
    OUT[e.UniqueId]['vals'] = []
    for parameter in s_parameter:
        value = '?'
        if parameter == 'Code':
            value = id
        elif parameter == 'Type':
            value = e.Category.Name if e.Category else None
        else:
            try:
                value = e.LookupParameter(parameter)
                if value.StorageType == 1:
                    value = value.AsInteger()
                elif value.StorageType == 2:
                    value = value.AsDouble()
                elif value.StorageType == 3:
                    value = value.AsString()
                else:
                    value = str(value)
            except:
                try:
                    value = str(value)
                except:
                    value = ""
            measure = '?'
            try:
                measure = p.Definition.GetDataType()
                if measure == SpecTypeId.Length:
                    value = value * 0.3048
                elif measure == SpecTypeId.Area:
                    value = value * 0.3048 * 0.3048
                elif measure == SpecTypeId.Volume:
                    value = value * 0.3048 * 0.3048 * 0.3048
                elif measure == SpecTypeId.Temperature:
                    value = value - 273.15
                elif measure == SpecTypeId.TemperatureDifference:
                    value = value
                elif measure == SpecTypeId.Angle:
                    value = value
                elif measure == SpecTypeId.Slope:
                    value = value
                elif measure == SpecTypeId.Number:
                    value = value
            except:
                pass
            OUT[e.UniqueId][parameter] = measure
        #OUT[id]['vals'].append(value.StorageType.Integer)
        
        #if parameter in list(s_converter.keys()):
        #    value = s_converter[parameter][value]
        s_value.append(value)
    return s_value

def ensure_dir(path):
    d = os.path.dirname(path)
    if d and not os.path.exists(d):
        os.makedirs(d)

def write_xlsx_or_csv(rows, xlsx_path, sheet):
    """
    rows: list of lists (including header)
    tries openpyxl; if unavailable or fails, writes CSV fallback
    returns: {"path": written_path, "format": "xlsx"|"csv"}
    """
    ensure_dir(xlsx_path)
    # try openpyxl
    try:
        import openpyxl
        from openpyxl import Workbook
        if os.path.exists(xlsx_path):
            wb = openpyxl.load_workbook(xlsx_path)
            if sheet in wb.sheetnames:
                ws = wb[sheet]
                # clear the sheet
                wb.remove(ws)
                ws = wb.create_sheet(sheet)
            else:
                ws = wb.create_sheet(sheet)
        else:
            wb = Workbook()
            ws = wb.active
            ws.title = sheet
        for r in rows:
            ws.append(r)
        wb.save(xlsx_path)
        return {"path": xlsx_path, "format": "xlsx"}
    except Exception as ex:
        # csv fallback
        csv_path = os.path.splitext(xlsx_path)[0] + ".csv"
        import csv
        with io.open(csv_path, "w", encoding="utf-8", newline="") as f:
            w = csv.writer(f, delimiter=';')
            for r in rows:
                w.writerow([u"" if v is None else v for v in r])
        return {"path": csv_path, "format": "csv", "note": "openpyxl non disponibile: scritto CSV"}

def hex_to_revit_color(hexstr):
    # accepts "#RRGGBB" or "RRGGBB"
    s = hexstr.strip()
    if s.startswith("#"):
        s = s[1:]
    if len(s) != 6:
        raise ValueError("Colore non valido: {}".format(hexstr))
    r = int(s[0:2], 16)
    g = int(s[2:4], 16)
    b = int(s[4:6], 16)
    return Color(r, g, b)

def get_solid_fill_pattern_id(document):
    # robust: trova il FillPatternElement con IsSolidFill True
    fps = FilteredElementCollector(document).OfClass(FillPatternElement)
    for fpe in fps:
        try:
            if fpe.GetFillPattern().IsSolidFill:
                return fpe.Id
        except:
            pass
    return None

def run_external_python(py_path):
    """
    Esegue uno script Python esterno.
    Preferisce usare sys.executable (CPython node); fallback a 'python'.
    In IronPython usa System.Diagnostics.Process.
    Ritorna (exitcode, stdout/stderr best-effort).
    """
    if not py_path or not os.path.exists(py_path):
        return (-1, "Script Python non trovato: {}".format(py_path))

    try:
        # Try CPython / subprocess
        import subprocess
        python_exec = sys.executable if sys.executable else "python"
        proc = subprocess.Popen([python_exec, py_path],
                                stdout=subprocess.PIPE,
                                stderr=subprocess.PIPE,
                                shell=False)
        out, err = proc.communicate()
        code = proc.returncode
        text = (out.decode('utf-8', 'ignore') + "\n" + err.decode('utf-8', 'ignore')).strip()
        return (code, text)
    except Exception as ex:
        # IronPython fallback: System.Diagnostics.Process
        try:
            import System
            from System.Diagnostics import Process, ProcessStartInfo
            psi = ProcessStartInfo()
            psi.FileName = "python"
            psi.Arguments = '"{}"'.format(py_path)
            psi.UseShellExecute = False
            psi.RedirectStandardOutput = True
            psi.RedirectStandardError = True
            p = Process()
            p.StartInfo = psi
            p.Start()
            p.WaitForExit()
            out = p.StandardOutput.ReadToEnd()
            err = p.StandardError.ReadToEnd()
            return (p.ExitCode, (out + "\n" + err))
        except Exception as ex2:
            return (-2, "Impossibile eseguire lo script: {} | {}".format(ex, ex2))

def read_output_colors(path_expected, n_expected):
    """
    Ritorna lista di stringhe colore (lunghezza n_expected).
    Ogni riga => es. '#AABBCC' (consentito anche senza '#').
    """
    if not path_expected or not os.path.exists(path_expected):
        raise IOError("File di output colori non trovato: {}".format(path_expected))
    s_color = []
    with io.open(path_expected, 'r', encoding='utf-8') as f:
        for line in f:
            s = line.strip()
            if s:
                s_color.append(s)
    if len(s_color) != n_expected:
        raise ValueError("Numero colori ({}) diverso dal numero elementi esportati ({})".format(len(s_color), n_expected))
    return s_color
# ______________________________________________
# --- 1) Raccolta elementi e scrittura Excel ---
s_element = get_elements_of_categories(doc)
s_header = list(s_parameter)
s_row = [s_header]

for e in s_element:
    row = [e.UniqueId]
    if s_parameter:
        row += read_params(e, s_parameter)
    s_row.append(row)


import json
import os
start0_file_content = '?'
with open(start0_file_pathandname, 'r') as file:
    start0_file_content = json.load(file)
start_file_pathandname = os.path.normpath(os.path.join(os.path.join(start0_file_pathandname, "..\\"), start0_file_content['start_file_name']))
start_file_content = json.load(open(start_file_pathandname))
input_folder_path = start_file_content['input_folder_path']
input_folder_path = os.path.normpath(os.path.join(start_file_pathandname, input_folder_path))
output_folder_path = start_file_content['output_folder_path']
output_folder_path = os.path.normpath(os.path.join(start_file_pathandname, output_folder_path))
excel_file_pathandname = os.path.join(input_folder_path, start_file_content['input_file_name'])
queries_sheet_name = start_file_content['queries_sheet_name']
elements_sheet_name = start_file_content['elements_sheet_name']
excel_info = write_xlsx_or_csv(s_row, excel_file_pathandname, elements_sheet_name)
python_script_external_pathandname = os.path.normpath(os.path.join(start0_file_pathandname, "..\\_CODE\\Intervenability_01.py"))
OUT['s_row'] = python_script_external_pathandname

# --- 2) Esecuzione script esterno (opzionale, se fornito) ---
ext_code = None
ext_text = None

#run_external_python(python_script_external_pathandname)
"""
# --- 3) Lettura output e applicazione colori (override in Active View) ---
applied = 0
s_error = []
if python_script_external_pathandname:
    try:
        color_strings = read_output_colors(external_output_path, len(s_element))
        # trova Solid Fill
        solid_fill_id = get_solid_fill_pattern_id(doc)
        if apply_in_active_view and solid_fill_id is not None and uidoc and uidoc.ActiveView:
            v = uidoc.ActiveView
            TransactionManager.Instance.EnsureInTransaction(doc)
            for idx, e in enumerate(s_element):
                try:
                    column = hex_to_revit_color(color_strings[idx])
                    ogs = OverrideGraphicSettings()
                    # superfici
                    ogs.SetSurfaceForegroundPatternId(solid_fill_id)
                    ogs.SetSurfaceForegroundPatternColor(column)
                    # linee
                    ogs.SetProjectionLineColor(column)
                    v.SetElementOverrides(e.Id, ogs)
                    applied += 1
                except Exception as ex:
                    s_error.append("Errore colore per {}: {}".format(e.UniqueId, ex))
            TransactionManager.Instance.TransactionTaskDone()
        else:
            s_error.append("Override non applicato (Active View non disponibile o Solid Fill mancante).")
    except Exception as ex:
        s_error.append("Lettura/applicazione colori fallita: {}".format(ex))

# --- Output report ---
OUT['More'] = {
    "elements_exported": len(s_element),
    "excel_written": excel_info,
    "external_script": {"exit_code": ext_code, "output": ext_text} if python_script_external_pathandname else None,
    "colors_applied": applied,
    "errors": s_error
}
"""
debug_dynamo_file_pathandname = os.path.join(output_folder_path, 'debug_dynamo.json')
with open(debug_dynamo_file_pathandname, 'w') as file:
    json.dump(OUT, file)

pass
# ----------------------------------------
python_script_solo_export_excel = Python()  # "Python Script_Solo Export Excel_funzionante"; CPython3; frozen; unwired: IN[0], IN[1], IN[2], IN[3], IN[4], IN[5]
# ---------- python_script_solo_export_excel.python (355 lines) ----------
import sys, os, io

# --- Dynamo / Revit plumbing ---
import clr
clr.AddReference('RevitServices')
from RevitServices.Persistence import DocumentManager
from RevitServices.Transactions import TransactionManager
from Autodesk.Revit.DB import SpecTypeId

clr.AddReference('RevitAPI')
from Autodesk.Revit.DB import (
    FilteredElementCollector, BuiltInCategory, ElementCategoryFilter, LogicalOrFilter,
    Element, Color, OverrideGraphicSettings, FillPatternElement, FillPatternTarget, View
)

doc = DocumentManager.Instance.CurrentDBDocument
uidoc = DocumentManager.Instance.CurrentUIApplication.ActiveUIDocument

# --- Inputs ---
s_parameter = IN[0]
start0_file_pathandname = IN[1]
apply_in_active_view = bool(IN[2])
diameter = IN[3]
duct_size_1 = IN[4]
duct_size_2 = IN[5]

OUT = {}
OUT['s_parameter'] = s_parameter

# --- Helpers ---
def get_elements_of_categories(document):
    s_category = [
        BuiltInCategory.OST_Walls,
        BuiltInCategory.OST_Floors,
        BuiltInCategory.OST_Ceilings,
        BuiltInCategory.OST_Windows,
        BuiltInCategory.OST_Doors
    ]
    s_filter = [ElementCategoryFilter(category) for category in s_category]
    or_filter = LogicalOrFilter(s_filter)
    column = FilteredElementCollector(document).WherePasses(or_filter).WhereElementIsNotElementType()
    # stable order: sort by UniqueId
    s_element = sorted(list(column), key=lambda e: e.UniqueId)
    return s_element

def read_params(e, s_parameter):
    s_converter = {
        'AtticFloor_CanBeCovered': {'No': 'FALSE', 'Sì': 'TRUE'},
        'Leaning': {'No': 'FALSE', 'Sì': 'TRUE'},
        'Bonding': {'No': 'FALSE', 'Sì': 'TRUE'},
        'Infill': {'No': 'FALSE', 'Sì': 'TRUE'},
        'Demolition': {'No': 'FALSE', 'Sì': 'TRUE'},
        'Type': {
            'Pavimenti': 'Surface:Floor:InnerSide',
            'Muri': 'Surface:Wall:InnerSide',
            'Controsoffitti': 'Surface:Ceiling:InnerSide',
            'Tetti': 'Surface:Roof:InnerSide',
            'Porte': 'Door/Window',
            'Finestre': 'Door/Window'
        }
    }

    id = e.UniqueId
    OUT[id] = {}
    s_value = []
    OUT[e.UniqueId]['vals'] = []

    for parameter in s_parameter:
        value = '?'

        if parameter == 'Code':
            value = id

        elif parameter == 'Type':
            value = e.Category.Name if e.Category else None

        else:
            # ======= FIX MINIMALE: usare SEMPRE "p" come parametro Revit =======
            try:
                p = e.LookupParameter(parameter)

                if p is None:
                    value = None
                else:
                    # leggo valore grezzo in base allo StorageType
                    if p.StorageType == 1:
                        value = p.AsInteger()
                    elif p.StorageType == 2:
                        value = p.AsDouble()
                    elif p.StorageType == 3:
                        value = p.AsString()
                    else:
                        value = str(p)

                    # conversione unità (solo se applicabile)
                    measure = '?'
                    try:
                        measure = p.Definition.GetDataType()

                        if measure == SpecTypeId.Length:
                            value = value * 0.3048
                        elif measure == SpecTypeId.Area:
                            value = value * 0.3048 * 0.3048
                        elif measure == SpecTypeId.Volume:
                            value = value * 0.3048 * 0.3048 * 0.3048
                        elif measure == SpecTypeId.Temperature:
                            value = value - 273.15
                        elif measure == SpecTypeId.TemperatureDifference:
                            value = value
                        elif measure == SpecTypeId.Angle:
                            value = value
                        elif measure == SpecTypeId.Slope:
                            value = value
                        elif measure == SpecTypeId.Number:
                            value = value
                    except:
                        pass

                    OUT[e.UniqueId][parameter] = str(measure)

            except:
                try:
                    value = str(value)
                except:
                    value = ""
            # ================================================================

        #OUT[id]['vals'].append(value.StorageType.Integer)

        #if parameter in list(s_converter.keys()):
        #    value = s_converter[parameter][value]

        s_value.append(value)

    return s_value

def ensure_dir(path):
    d = os.path.dirname(path)
    if d and not os.path.exists(d):
        os.makedirs(d)

def write_xlsx_or_csv(rows, xlsx_path, sheet):
    """
    rows: list of lists (including header)
    tries openpyxl; if unavailable or fails, writes CSV fallback
    returns: {"path": written_path, "format": "xlsx"|"csv"}
    """
    ensure_dir(xlsx_path)
    # try openpyxl
    try:
        import openpyxl
        from openpyxl import Workbook
        if os.path.exists(xlsx_path):
            wb = openpyxl.load_workbook(xlsx_path)
            if sheet in wb.sheetnames:
                ws = wb[sheet]
                # clear the sheet
                wb.remove(ws)
                ws = wb.create_sheet(sheet)
            else:
                ws = wb.create_sheet(sheet)
        else:
            wb = Workbook()
            ws = wb.active
            ws.title = sheet
        for r in rows:
            ws.append(r)
        wb.save(xlsx_path)
        return {"path": xlsx_path, "format": "xlsx"}
    except Exception as ex:
        # csv fallback
        csv_path = os.path.splitext(xlsx_path)[0] + ".csv"
        import csv
        with io.open(csv_path, "w", encoding="utf-8", newline="") as f:
            w = csv.writer(f, delimiter=';')
            for r in rows:
                w.writerow([u"" if v is None else v for v in r])
        return {"path": csv_path, "format": "csv", "note": "openpyxl non disponibile: scritto CSV"}

def hex_to_revit_color(hexstr):
    # accepts "#RRGGBB" or "RRGGBB"
    s = hexstr.strip()
    if s.startswith("#"):
        s = s[1:]
    if len(s) != 6:
        raise ValueError("Colore non valido: {}".format(hexstr))
    r = int(s[0:2], 16)
    g = int(s[2:4], 16)
    b = int(s[4:6], 16)
    return Color(r, g, b)

def get_solid_fill_pattern_id(document):
    # robust: trova il FillPatternElement con IsSolidFill True
    fps = FilteredElementCollector(document).OfClass(FillPatternElement)
    for fpe in fps:
        try:
            if fpe.GetFillPattern().IsSolidFill:
                return fpe.Id
        except:
            pass
    return None

def run_external_python(py_path):
    """
    Esegue uno script Python esterno.
    Preferisce usare sys.executable (CPython node); fallback a 'python'.
    In IronPython usa System.Diagnostics.Process.
    Ritorna (exitcode, stdout/stderr best-effort).
    """
    if not py_path or not os.path.exists(py_path):
        return (-1, "Script Python non trovato: {}".format(py_path))

    try:
        # Try CPython / subprocess
        import subprocess
        python_exec = sys.executable if sys.executable else "python"
        proc = subprocess.Popen([python_exec, py_path],
                                stdout=subprocess.PIPE,
                                stderr=subprocess.PIPE,
                                shell=False)
        out, err = proc.communicate()
        code = proc.returncode
        text = (out.decode('utf-8', 'ignore') + "\n" + err.decode('utf-8', 'ignore')).strip()
        return (code, text)
    except Exception as ex:
        # IronPython fallback: System.Diagnostics.Process
        try:
            import System
            from System.Diagnostics import Process, ProcessStartInfo
            psi = ProcessStartInfo()
            psi.FileName = "python"
            psi.Arguments = '"{}"'.format(py_path)
            psi.UseShellExecute = False
            psi.RedirectStandardOutput = True
            psi.RedirectStandardError = True
            p = Process()
            p.StartInfo = psi
            p.Start()
            p.WaitForExit()
            out = p.StandardOutput.ReadToEnd()
            err = p.StandardError.ReadToEnd()
            return (p.ExitCode, (out + "\n" + err))
        except Exception as ex2:
            return (-2, "Impossibile eseguire lo script: {} | {}".format(ex, ex2))

def read_output_colors(path_expected, n_expected):
    """
    Ritorna lista di stringhe colore (lunghezza n_expected).
    Ogni riga => es. '#AABBCC' (consentito anche senza '#').
    """
    if not path_expected or not os.path.exists(path_expected):
        raise IOError("File di output colori non trovato: {}".format(path_expected))
    s_color = []
    with io.open(path_expected, 'r', encoding='utf-8') as f:
        for line in f:
            s = line.strip()
            if s:
                s_color.append(s)
    if len(s_color) != n_expected:
        raise ValueError("Numero colori ({}) diverso dal numero elementi esportati ({})".format(len(s_color), n_expected))
    return s_color

# ______________________________________________
# --- 1) Raccolta elementi e scrittura Excel ---
s_element = get_elements_of_categories(doc)
s_header = list(s_parameter)
s_row = [s_header]

for e in s_element:
    row = []
    if s_parameter:
        row += read_params(e, s_parameter)
    s_row.append(row)

import json
import os

start0_file_content = '?'
with open(start0_file_pathandname, 'r') as file:
    start0_file_content = json.load(file)

start_file_pathandname = os.path.normpath(
    os.path.join(os.path.join(start0_file_pathandname, "..\\"), start0_file_content['start_file_name'])
)
start_file_content = json.load(open(start_file_pathandname))

input_folder_path = start_file_content['input_folder_path']
input_folder_path = os.path.normpath(os.path.join(start_file_pathandname, input_folder_path))

output_folder_path = start_file_content['output_folder_path']
output_folder_path = os.path.normpath(os.path.join(start_file_pathandname, output_folder_path))

excel_file_pathandname = os.path.join(input_folder_path, start_file_content['input_file_name'])
queries_sheet_name = start_file_content['queries_sheet_name']
elements_sheet_name = start_file_content['elements_sheet_name']

excel_info = write_xlsx_or_csv(s_row, excel_file_pathandname, elements_sheet_name)

python_script_external_pathandname = os.path.normpath(
    os.path.join(start0_file_pathandname, "..\\_CODE\\Intervenability_01-LFO.py")
)
OUT['s_row'] = python_script_external_pathandname

# --- 2) Esecuzione script esterno (opzionale, se fornito) ---
ext_code = None
ext_text = None

#run_external_python(python_script_external_pathandname)

"""
# --- 3) Lettura output e applicazione colori (override in Active View) ---
applied = 0
s_error = []
if python_script_external_pathandname:
    try:
        color_strings = read_output_colors(external_output_path, len(s_element))
        # trova Solid Fill
        solid_fill_id = get_solid_fill_pattern_id(doc)
        if apply_in_active_view and solid_fill_id is not None and uidoc and uidoc.ActiveView:
            v = uidoc.ActiveView
            TransactionManager.Instance.EnsureInTransaction(doc)
            for idx, e in enumerate(s_element):
                try:
                    column = hex_to_revit_color(color_strings[idx])
                    ogs = OverrideGraphicSettings()
                    # superfici
                    ogs.SetSurfaceForegroundPatternId(solid_fill_id)
                    ogs.SetSurfaceForegroundPatternColor(column)
                    # linee
                    ogs.SetProjectionLineColor(column)
                    v.SetElementOverrides(e.Id, ogs)
                    applied += 1
                except Exception as ex:
                    s_error.append("Errore colore per {}: {}".format(e.UniqueId, ex))
            TransactionManager.Instance.TransactionTaskDone()
        else:
            s_error.append("Override non applicato (Active View non disponibile o Solid Fill mancante).")
    except Exception as ex:
        s_error.append("Lettura/applicazione colori fallita: {}".format(ex))

# --- Output report ---
OUT['More'] = {
    "elements_exported": len(s_element),
    "excel_written": excel_info,
    "external_script": {"exit_code": ext_code, "output": ext_text} if python_script_external_pathandname else None,
    "colors_applied": applied,
    "errors": s_error
}
"""

debug_dynamo_file_pathandname = os.path.join(output_folder_path, 'debug_dynamo.json')
with open(debug_dynamo_file_pathandname, 'w') as file:
    json.dump(OUT, file)

pass
# ----------------------------------------
s_parameter = CodeBlock()
# ---------- s_parameter.designscript (1 lines) ----------
["Code","Type","ThroughHole_Position","ThroughHole_Diameter_Max","Opening_Reduction_Height_SuspCeiling_Length_Max","Opening_Reduction_Height_RaisedFloor_Length_Max","Opening_Reduction_Width_Side_Length_Max","Perforation_Depth_Max","Perforation_Diameter_Max","Perforation_Position","Perforation_Length","Perforation_Width","SurfCov_Level","CutOut_Depth_Max","CutOut_Width_Max","Attic_IsAccessible","Attic_IsWalkable","AtticFloor_CanBeCovered","Bonding","Leaning","DemolitionOfLayers_Depth_Max","Demolition","Excavation","Infill","UseAsADuctSpace_Side_Max","UseAsADuctSpace_Side_Min"];
# ----------------------------------------
start_file0_pathandname = StringInput("C:\PATH\TO\hbim-intervenability-workflows\START.json")
apply_in_active_view = BoolSelector(true)
python_script = Python(IN[0]=s_parameter, IN[1]=start_file0_pathandname, IN[2]=apply_in_active_view)  # CPython3; unwired: IN[3], IN[4], IN[5]
# ---------- python_script.python (526 lines) ----------
import sys, os, json, re, subprocess

# --- Dynamo / Revit plumbing ---
import clr

clr.AddReference("RevitServices")
from RevitServices.Persistence import DocumentManager
from RevitServices.Transactions import TransactionManager

clr.AddReference("RevitAPI")
from Autodesk.Revit.DB import (
    SpecTypeId,
    FilteredElementCollector,
    BuiltInCategory,
    ElementCategoryFilter,
    LogicalOrFilter,
    Color,
    OverrideGraphicSettings,
    FillPatternElement,
)

doc = DocumentManager.Instance.CurrentDBDocument
uidoc = DocumentManager.Instance.CurrentUIApplication.ActiveUIDocument


# ---------------------------------------------------------------------------
# INPUTS FROM DYNAMO
# ---------------------------------------------------------------------------

# IN[0] = list of Revit parameters to export
# IN[1] = path to START.json
# IN[2] = apply colours in active view, True/False
# IN[3] = optional path to external Python executable
# IN[4] = optional path to external Python script
# IN[5] = trigger / unused

s_parameter = IN[0]
start0_file_pathandname = IN[1]
apply_in_active_view = bool(IN[2])

python_exe_input = IN[3] if len(IN) > 3 else None
external_script_input = IN[4] if len(IN) > 4 else None
_ = IN[5] if len(IN) > 5 else None


# ---------------------------------------------------------------------------
# PATH HELPERS
# ---------------------------------------------------------------------------

def norm(path):
    return os.path.normpath(str(path))


def is_empty(value):
    if value is None:
        return True
    if str(value).strip() in ["", "?", "None", "null"]:
        return True
    return False


def must_exist(path, label):
    if not path or not os.path.exists(path):
        raise Exception("{} not found: {}".format(label, path))


def ensure_parent_dir(path):
    directory = os.path.dirname(path)
    if directory and not os.path.exists(directory):
        os.makedirs(directory)


must_exist(start0_file_pathandname, "START.json")

BASE_DIR = norm(os.path.dirname(start0_file_pathandname))


# ---------------------------------------------------------------------------
# READ CONFIGURATION FILES
# ---------------------------------------------------------------------------

with open(start0_file_pathandname, "r", encoding="utf-8") as file:
    start0 = json.load(file)

start_file_name = start0.get("start_file_name", "START - AdD - Dynamo.json")
start_file_pathandname = norm(os.path.join(BASE_DIR, start_file_name))

must_exist(start_file_pathandname, "START - AdD - Dynamo.json")

with open(start_file_pathandname, "r", encoding="utf-8") as file:
    cfg = json.load(file)

input_file_name = cfg.get("input_file_name", "InputDataLFO.xlsx")
elements_sheet_name = cfg.get("elements_sheet_name", "ELEMENTS_Dynamo")


# ---------------------------------------------------------------------------
# LOCAL WORKFLOW FOLDERS
# ---------------------------------------------------------------------------

# The repository structure is expected to be:
#
# hbim-intervenability-workflows/
# ├── START.json
# ├── START - AdD - Dynamo.json
# ├── python/
# │   └── Intervenability_01-LFO.py
# ├── dynamo/
# │   └── Intervenability_02-LFO.dyn
# └── AdD_Dynamo/
#     ├── IN/
#     │   └── InputDataLFO.xlsx
#     └── OUT/
#         └── Intervenability_RESULTS.xlsx

IN_DIR = norm(os.path.join(BASE_DIR, "AdD_Dynamo", "IN"))
OUT_DIR = norm(os.path.join(BASE_DIR, "AdD_Dynamo", "OUT"))

INPUT_XLSX = norm(os.path.join(IN_DIR, input_file_name))
RESULTS_XLSX_DEFAULT = norm(os.path.join(OUT_DIR, "Intervenability_RESULTS.xlsx"))


# ---------------------------------------------------------------------------
# EXTERNAL SCRIPT AND PYTHON EXECUTABLE
# ---------------------------------------------------------------------------

if not is_empty(external_script_input):
    external_script_path = norm(external_script_input)
else:
    external_script_path = norm(
        os.path.join(BASE_DIR, "python", "Intervenability_01-LFO.py")
    )

must_exist(external_script_path, "Intervenability_01-LFO.py")

if not is_empty(python_exe_input):
    PYTHON_EXE = norm(python_exe_input)
else:
    # Fallback: use the Python executable available to the current environment.
    # In many Revit/Dynamo setups, users may need to pass their external Python
    # executable explicitly through IN[3].
    PYTHON_EXE = sys.executable

must_exist(PYTHON_EXE, "Python executable")


# ---------------------------------------------------------------------------
# REVIT HELPERS
# ---------------------------------------------------------------------------

def get_elements_of_categories(document):
    categories = [
        BuiltInCategory.OST_Walls,
        BuiltInCategory.OST_Floors,
        BuiltInCategory.OST_Ceilings,
        BuiltInCategory.OST_Windows,
        BuiltInCategory.OST_Doors,
    ]

    filters = [ElementCategoryFilter(category) for category in categories]
    or_filter = LogicalOrFilter(filters)

    collector = (
        FilteredElementCollector(document)
        .WherePasses(or_filter)
        .WhereElementIsNotElementType()
    )

    return sorted(list(collector), key=lambda element: element.UniqueId)


def get_solid_fill_pattern_id(document):
    fill_patterns = FilteredElementCollector(document).OfClass(FillPatternElement)

    for fill_pattern_element in fill_patterns:
        try:
            if fill_pattern_element.GetFillPattern().IsSolidFill:
                return fill_pattern_element.Id
        except Exception:
            pass

    return None


def hex_to_revit_color(hex_string):
    value = str(hex_string).strip()

    if value.startswith("#"):
        value = value[1:]

    if len(value) != 6:
        raise ValueError("Invalid colour value: {}".format(hex_string))

    red = int(value[0:2], 16)
    green = int(value[2:4], 16)
    blue = int(value[4:6], 16)

    return Color(red, green, blue)


# ---------------------------------------------------------------------------
# PARAMETER READING
# ---------------------------------------------------------------------------

def read_params(element, parameter_names):
    element_unique_id = element.UniqueId
    values = []

    for parameter_name in parameter_names:
        value = "?"

        if parameter_name == "Code":
            value = element_unique_id

        elif parameter_name == "Type":
            value = element.Category.Name if element.Category else None

        else:
            try:
                parameter = element.LookupParameter(parameter_name)

                if parameter is None:
                    value = None

                else:
                    if parameter.StorageType == 1:
                        value = parameter.AsInteger()
                    elif parameter.StorageType == 2:
                        value = parameter.AsDouble()
                    elif parameter.StorageType == 3:
                        value = parameter.AsString()
                    else:
                        value = str(parameter)

                    # Unit conversion where applicable.
                    try:
                        measure = parameter.Definition.GetDataType()

                        if measure == SpecTypeId.Length:
                            value = value * 0.3048
                        elif measure == SpecTypeId.Area:
                            value = value * 0.3048 * 0.3048
                        elif measure == SpecTypeId.Volume:
                            value = value * 0.3048 * 0.3048 * 0.3048
                        elif measure == SpecTypeId.Temperature:
                            value = value - 273.15
                        elif measure == SpecTypeId.TemperatureDifference:
                            value = value
                        elif measure == SpecTypeId.Angle:
                            value = value
                        elif measure == SpecTypeId.Slope:
                            value = value
                        elif measure == SpecTypeId.Number:
                            value = value
                    except Exception:
                        pass

            except Exception:
                try:
                    value = str(value)
                except Exception:
                    value = ""

        values.append(value)

    return values


# ---------------------------------------------------------------------------
# 1. EXPORT REVIT ELEMENTS TO INPUT EXCEL FILE
# ---------------------------------------------------------------------------

elements = get_elements_of_categories(doc)

rows = [list(s_parameter)]

for element in elements:
    rows.append(read_params(element, s_parameter))

ensure_parent_dir(INPUT_XLSX)

import openpyxl
from openpyxl import Workbook

if os.path.exists(INPUT_XLSX):
    workbook = openpyxl.load_workbook(INPUT_XLSX)

    if elements_sheet_name in workbook.sheetnames:
        old_sheet = workbook[elements_sheet_name]
        workbook.remove(old_sheet)

else:
    workbook = Workbook()

    try:
        workbook.remove(workbook.active)
    except Exception:
        pass

worksheet = workbook.create_sheet(elements_sheet_name)

for row in rows:
    worksheet.append(row)

workbook.save(INPUT_XLSX)


# ---------------------------------------------------------------------------
# 2. RUN EXTERNAL PYTHON SCRIPT
# ---------------------------------------------------------------------------

external_exit_code = None
external_stdout = ""
external_stderr = ""

try:
    process = subprocess.Popen(
        [PYTHON_EXE, external_script_path],
        stdout=subprocess.PIPE,
        stderr=subprocess.PIPE,
        shell=False,
    )

    stdout_bytes, stderr_bytes = process.communicate()

    external_exit_code = process.returncode
    external_stdout = stdout_bytes.decode("utf-8", "ignore")
    external_stderr = stderr_bytes.decode("utf-8", "ignore")

except Exception as error:
    external_exit_code = -2
    external_stderr = "Subprocess error: {}".format(error)


# ---------------------------------------------------------------------------
# 3. FIND RESULTS FILE
# ---------------------------------------------------------------------------

results_candidates = [
    RESULTS_XLSX_DEFAULT,
    norm(os.path.join(IN_DIR, "Intervenability_RESULTS.xlsx")),
]

# Try to read the exact path from stdout if the external script printed it.
match = re.search(
    r"Salvato Excel risultati:\s*(.+Intervenability_RESULTS\.xlsx)",
    external_stdout,
)

if match:
    candidate = norm(match.group(1).strip())

    allowed_root = norm(os.path.join(BASE_DIR, "AdD_Dynamo"))

    if candidate.startswith(allowed_root):
        results_candidates.insert(0, candidate)

# Remove duplicates while preserving order.
seen = set()
unique_results_candidates = []

for candidate in results_candidates:
    if candidate not in seen:
        seen.add(candidate)
        unique_results_candidates.append(candidate)

results_candidates = unique_results_candidates

results_found_path = None

for candidate in results_candidates:
    if os.path.exists(candidate):
        results_found_path = candidate
        break


# ---------------------------------------------------------------------------
# 4. APPLY COLOURS TO ACTIVE REVIT VIEW
# ---------------------------------------------------------------------------

applied = 0
errors = []

if apply_in_active_view:
    if results_found_path is None:
        errors.append(
            "Results not found. Checked paths: {}".format(results_candidates)
        )

    else:
        try:
            results_workbook = openpyxl.load_workbook(
                results_found_path,
                data_only=True,
            )

            if "SUMMARY" not in results_workbook.sheetnames:
                raise Exception(
                    "Sheet 'SUMMARY' not found in {}".format(results_found_path)
                )

            summary_sheet = results_workbook["SUMMARY"]

            header = [
                str(cell.value).strip() if cell.value is not None else ""
                for cell in summary_sheet[1]
            ]

            def column_index(name):
                return header.index(name) if name in header else None

            index_code = column_index("Code")
            index_r = column_index("R")
            index_g = column_index("G")
            index_b = column_index("B")
            index_hex = column_index("ColourHex")

            if index_code is None:
                raise Exception("Column 'Code' is missing in SUMMARY.")

            color_map = {}

            for row in summary_sheet.iter_rows(min_row=2, values_only=True):
                if not row:
                    continue

                code = row[index_code]

                if code is None:
                    continue

                code = str(code).strip()

                # Prefer RGB columns.
                if (
                    index_r is not None
                    and index_g is not None
                    and index_b is not None
                    and row[index_r] is not None
                ):
                    try:
                        red = int(float(row[index_r]))
                        green = int(float(row[index_g]))
                        blue = int(float(row[index_b]))

                        red = max(0, min(255, red))
                        green = max(0, min(255, green))
                        blue = max(0, min(255, blue))

                        color_map[code] = (red, green, blue)
                        continue

                    except Exception:
                        pass

                # Fallback to HEX colour.
                if index_hex is not None and row[index_hex]:
                    try:
                        revit_colour = hex_to_revit_color(row[index_hex])
                        color_map[code] = (
                            revit_colour.Red,
                            revit_colour.Green,
                            revit_colour.Blue,
                        )
                    except Exception:
                        pass

            solid_fill_id = get_solid_fill_pattern_id(doc)

            if solid_fill_id is None:
                raise Exception("Solid Fill pattern not found.")

            active_view = uidoc.ActiveView if uidoc else None

            if active_view is None:
                raise Exception("Active view not available.")

            TransactionManager.Instance.EnsureInTransaction(doc)

            for element in elements:
                unique_id = element.UniqueId

                if unique_id not in color_map:
                    continue

                red, green, blue = color_map[unique_id]
                revit_colour = Color(red, green, blue)

                overrides = OverrideGraphicSettings()
                overrides.SetSurfaceForegroundPatternId(solid_fill_id)
                overrides.SetSurfaceForegroundPatternColor(revit_colour)
                overrides.SetProjectionLineColor(revit_colour)

                active_view.SetElementOverrides(element.Id, overrides)
                applied += 1

            TransactionManager.Instance.TransactionTaskDone()

        except Exception as error:
            errors.append("Colour application failed: {}".format(error))

else:
    errors.append("apply_in_active_view = False")


# ---------------------------------------------------------------------------
# OUTPUT TO DYNAMO
# ---------------------------------------------------------------------------

OUT = {
    "BASE_DIR": BASE_DIR,
    "IN_DIR": IN_DIR,
    "OUT_DIR": OUT_DIR,
    "input_written": INPUT_XLSX,
    "elements_exported": len(elements),
    "external_script": external_script_path,
    "python_exe": PYTHON_EXE,
    "external_exit_code": external_exit_code,
    "external_stdout": external_stdout,
    "external_stderr": external_stderr,
    "results_candidates": results_candidates,
    "results_found_path": results_found_path,
    "apply_in_active_view": apply_in_active_view,
    "colors_applied": applied,
    "errors": errors,
}
# ----------------------------------------
watch = Watch(python_script)
